# Dynamo graph DY 2.3 - B5 - Replace family.dyn (Dynamo 2.12.1.8246)
# packages: Bakery 2019.5.8

# group: Lokacija familija sa kojima se update-uju druge familije
string = StringInput("C:\Users\nikola.markovic\Desktop\Import")  # graph input
code_block = CodeBlock { "*.rfa"; }
contentsAll = Custom[Directory.ContentsAll](dir=string, searchString=code_block)  # package Bakery

# group: Lokacija familija koje treba da se update-uju
string_2 = StringInput("C:\Users\nikola.markovic\Desktop\EXPORT")  # graph input
code_block_2 = CodeBlock { "*.rfa"; }
contentsAll_2 = Custom[Directory.ContentsAll](dir=string_2, searchString=code_block_2)

apdejter_3000 = Python(IN[0]=contentsAll, IN[1]=contentsAll_2)  # IronPython2
# ---------- apdejter_3000.python (65 lines) ----------
import clr
clr.AddReference('RevitAPI')
from Autodesk.Revit.DB import *
clr.AddReference('RevitServices')

# Revit and Dynamo modules
from Autodesk.Revit.DB import Document, FamilySource, IFamilyLoadOptions
from RevitServices.Persistence import DocumentManager
from RevitServices.Transactions import TransactionManager

uiapp = DocumentManager.Instance.CurrentUIApplication
app = uiapp.Application

#input assigned to IN variable
paths = IN[0]
docpaths = IN[1]

#wrap input inside a list if not a list.
if not isinstance(paths, list): 
    paths = [paths]
if not isinstance(docpaths, list): 
    docpaths = [docpaths]

#ensure loaded families can overwrite existing families.
class FamilyOption(IFamilyLoadOptions):
    def OnFamilyFound(self, familyInUse, overwriteParameterValues):
        overwriteParameterValues = True
        return True

    def OnSharedFamilyFound(self, sharedFamily, familyInUse, source, overwriteParameterValues):
        source = FamilySource.Family
        overwriteParameterValues = True
        return True     

#core data processing
documents = []
families = []
for docpath in docpaths:
    doc=app.OpenDocumentFile(docpath)
    documents.append(doc)
for path in paths:
    family_doc = app.OpenDocumentFile(path)
    families.append(family_doc)

for document in documents:
    map(lambda family: family.LoadFamily(document, FamilyOption()),
    families)

map(lambda x: x.Close(False), families)
map(lambda x: x.Close(True), documents)

# output assigned to the OUT variable
OUT = [paths, docpaths]

#core data processing
for path in paths:
    try:
        famDoc = app.OpenDocumentFile(path)
        famDoc.LoadFamily(doc, FamilyOption())
        famDoc.Close(False)
    except:
        pass

#output assigned the OUT variable
OUT = paths
# ----------------------------------------
